# Grasshopper definition AddTwoNumbers.gh (Grasshopper 1.0.8)

A = GetNumber(AtLeast=1, AtMost=1, Maximum=1.797693135e+308, Minimum=-1.797693135e+308, TreeAccess=False)
B = GetNumber(AtLeast=1, AtMost=1, Maximum=1.797693135e+308, Minimum=-1.797693135e+308, TreeAccess=False)
addition = Addition(A=A, B=B)
panel = Panel(addition)
context_print = ContextPrint(Text=panel)
